# Grasshopper definition PilarVolume.gh (Grasshopper 1.0.8)

panel = Panel("C:\MPDA\Umbracle\Umbracle\Umbracle.Volume.py")
file_path = FilePath("C:\MPDA\Umbracle\YaraVolume.gh")
python_3_script = Python3Script(
    tri_side=Slider(14, range=0..100),
    count_A=Slider(5, range=0..100),
    count_B=Slider(4, range=0..100),
    count_C=Slider(5, range=0..100),
    main_rad=Slider(3, range=0..100),
    min_r=Slider(4, range=0..100),
    max_r=Slider(18, range=0..100),
    fillet_val=Slider(0, range=0..100),
    seed=Slider(23, range=0..100),
    r=Slider(4, range=0..100))  # -> out, main_circles, secondary_circles, boundary_curves, individual_surfaces
# ---------- python_3_script: Python ----------
import Rhino.Geometry as rg
import math
import random

# Initialize output lists
main_circles = []
secondary_circles = []
boundary_curves = []
individual_surfaces = []

# --- INPUTS ---
# tri_side, main_rad, count_A, count_B, count_C, r (list), fillet_val, seed (int)

# 1. Fixing Randomness (Seed)
# This ensures that when you change tri_side, the SHAPES stay the same
random.seed(seed)

# 2. Setup Centers (Equilateral Triangle)
h = (math.sqrt(3) / 3) * tri_side
centers = [
    rg.Point3d(0, h, 0),
    rg.Point3d(-tri_side / 2, -h / 2, 0),
    rg.Point3d(tri_side / 2, -h / 2, 0)
]
counts = [int(count_A), int(count_B), int(count_C)]

# Extract radius domain from list 'r'
# Extract radius domain safely
if isinstance(r, list):
    r_min, r_max = min(r), max(r)
else:
    # If r is just a single number, min and max are the same
    r_min = r_max = r

for i in range(3):
    center = centers[i]
    
    # Output 1: Main Base Circles
    main_c = rg.Circle(center, main_rad).ToNurbsCurve()
    main_circles.append(main_c)
    
    # 3. Create Secondary Circles
    group_circles = []
    for _ in range(counts[i]):
        # Random distribution relative to (0,0,0) first to keep shape static
        r_dist = main_rad * math.sqrt(random.random())
        theta = random.random() * 2 * math.pi
        
        # Local point (before moving to triangle center)
        local_pt = rg.Point3d(r_dist * math.cos(theta), r_dist * math.sin(theta), 0)
        
        # Random radius for this specific circle
        sec_r = random.uniform(r_min, r_max)
        sec_c = rg.Circle(local_pt, sec_r).ToNurbsCurve()
        group_circles.append(sec_c)

    # 4. Create Boundary (Union) at Origin for Stability
    # We union them at 0,0,0 so the calculation is more precise
    union_results = rg.Curve.CreateBooleanUnion(group_circles, 0.001)
    
    if union_results:
        # Get the outermost boundary
        crv = union_results[0]
        
        # Smooth the joins
        smoothed = rg.Curve.CreateFilletCornersCurve(crv, fillet_val, 0.001, 0.001)
        final_crv = smoothed if smoothed else crv
        
        # --- ALIGNMENT LOGIC ---
        # Move the static organic shape to the triangle vertex center
        # This keeps the shape identical even when tri_side changes
        final_crv.Translate(rg.Vector3d(center))
        boundary_curves.append(final_crv)
        
        # Move the secondary circles to the center for visualization
        for c_sec in group_circles:
            c_sec.Translate(rg.Vector3d(center))
            secondary_circles.append(c_sec)
            
        # Output 4: Individual Surfaces
        srf = rg.Brep.CreatePlanarBreps(final_crv, 0.001)
        if srf:
            individual_surfaces.append(srf[0])

# Assign to Grasshopper Outputs
a = main_circles
b = secondary_circles
c = boundary_curves
d = individual_surfaces
# ---------- end python_3_script ----------
read_file = ReadFile(File=file_path, PerLineParse=False)
curve = Curve([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])
curve_2 = Curve(python_3_script.secondary_circles)
curve_3 = Curve(python_3_script.boundary_curves)
surface = Surface(python_3_script.individual_surfaces)
curve_4 = Curve(python_3_script.main_circles)
panel_2 = Panel(read_file)
python_3_script_2 = Python3Script(
    script=read_file,
    input_curves=curve,
    divisions=Slider(7, range=5..50),
    start_param_offset=Slider(0.11, range=0..1),
    min_distance=Slider(0.8, range=0.5..5),
    max_distance=Slider(3, range=2..20),
    min_height=Slider(2, range=1..20),
    max_height=Slider(9, range=2..50),
    voronoi_offset=Slider(0.21, range=0.1..1),
    extrusion_distance=Slider(0.18, range=0..1))  # -> out, a, division_points, vertical_lines, lofted_surface, voronoi_edges, offset_edges, wall_surfaces, final_extrusions; unedited script template
list_item = ListItem(List=surface, Index=0, Wrap=True)  # -> Item, Item1, Item2
surface_2 = Surface(list_item.Item)
surface_3 = Surface(list_item.Item1)
surface_4 = Surface(list_item.Item2)
curve_5 = Curve(list_item.Item)
curve_6 = Curve(list_item.Item2)
curve_7 = Curve(list_item.Item1)
point = Point(python_3_script_2.division_points)
merge = Merge(Data1=curve_5, Data2=curve_7, Data3=curve_6)
python_3_script_3 = Python3Script(
    Curves=merge,
    count=Slider(36, range=5..50),
    d_min=Slider(0.4, range=0..1),
    d_max=Slider(5.1, range=0..10),
    h_start=Slider(2, range=0..10),
    h_end=Slider(6, range=0..10),
    ratio=Slider(0.3, range=0.1..1))  # -> out, a, b, c, d; inputs Curves: list of Curve, count: Int32, d_min: Double, d_max: Double, h_start: Double, h_end: Double, ratio: Double
# ---------- python_3_script_3: Python ----------
import Rhino.Geometry as rg
import Grasshopper as gh
import Grasshopper.Kernel.Data as ghd
import random

def get_smooth_division(target_crv, other_curves, num_pts, d_min, d_max):
    # --- Mantenemos tu lógica de división progresiva ---
    samples = 200
    params = target_crv.DivideByCount(samples, True)
    dist_map = []
    for t in params:
        pt = target_crv.PointAt(t)
        min_d = float("inf")
        for other in other_curves:
            if other == target_crv: continue
            _, t_close = other.ClosestPoint(pt)
            dist = pt.DistanceTo(other.PointAt(t_close))
            if dist < min_d: min_d = dist
        dist_map.append(min_d)
    
    d_low, d_high = min(dist_map), max(dist_map)
    range_d = (d_high - d_low) if d_high > d_low else 1.0
    
    cumulative_lengths = [0.0]
    current_length = 0.0
    for i in range(len(params) - 1):
        local_d = (dist_map[i] + dist_map[i+1]) / 2.0
        t_map = (local_d - d_low) / range_d
        density = 1.0 / (d_min + (d_max - d_min) * t_map)
        step_dist = (params[i+1] - params[i]) * density
        current_length += step_dist
        cumulative_lengths.append(current_length)
    
    final_pts, final_dists = [], []
    total_len = cumulative_lengths[-1]
    for j in range(num_pts):
        target_val = (j / float(num_pts - 1)) * total_len
        for k in range(len(cumulative_lengths) - 1):
            if cumulative_lengths[k] <= target_val <= cumulative_lengths[k+1]:
                t_local = (target_val - cumulative_lengths[k]) / (cumulative_lengths[k+1] - cumulative_lengths[k])
                t_curve = params[k] + t_local * (params[k+1] - params[k])
                final_pts.append(target_crv.PointAt(t_curve))
                final_dists.append(dist_map[k] + t_local * (dist_map[k+1] - dist_map[k]))
                break
    return final_pts, final_dists

# --- INICIO DE PROCESAMIENTO ---

p_base_tree = gh.DataTree[rg.Point3d]()
p_top_tree = gh.DataTree[rg.Point3d]()
l_tree = gh.DataTree[rg.Line]()
arc_tree = gh.DataTree[rg.ArcCurve]()

all_top_points = [] 
used_ids = set() 

# 1. Generar puntos y líneas
for i in range(len(Curves)):
    path = ghd.GH_Path(i)
    pts, dists = get_smooth_division(Curves[i], Curves, count, d_min, d_max)
    
    group = []
    for j, p in enumerate(pts):
        h = random.uniform(h_start + i, h_end + i)
        p_top = p + rg.Vector3d(0, 0, h)
        
        p_base_tree.Add(p, path)
        p_top_tree.Add(p_top, path)
        l_tree.Add(rg.Line(p, p_top), path)
        
        group.append({'pt': p_top, 'dist': dists[j], 'id': (i, j)})
    all_top_points.append(group)

# 2. Lógica de Arcos con el slider 'ratio'
for i in range(len(all_top_points)):
    path = ghd.GH_Path(i)
    # Ordenamos por cercanía base para que el 'ratio' afecte primero a las zonas próximas
    sorted_candidates = sorted(all_top_points[i], key=lambda x: x['dist'])
    
    # El número de intentos de emparejamiento depende del ratio
    num_to_process = int(len(sorted_candidates) * ratio)
    processed_count = 0
    
    for item in sorted_candidates:
        # Si ya hemos intentado emparejar el cupo definido por el ratio, paramos
        if processed_count >= num_to_process: break
        
        id_a = item['id']
        if id_a in used_ids: continue
        
        pt_a = item['pt']
        best_partner = None
        min_search_dist = float("inf")
        
        # Buscar pareja en otras ramas
        for other_idx in range(len(all_top_points)):
            if i == other_idx: continue
            
            for other_item in all_top_points[other_idx]:
                id_b = other_item['id']
                if id_b not in used_ids:
                    d = pt_a.DistanceTo(other_item['pt'])
                    if d < min_search_dist:
                        min_search_dist = d
                        best_partner = other_item
        
        # Emparejamiento 1 a 1
        if best_partner:
            used_ids.add(id_a)
            used_ids.add(best_partner['id'])
            
            pt_b = best_partner['pt']
            mid = (pt_a + pt_b) / 2.0
            mid.Z += pt_a.DistanceTo(pt_b) * 0.25 # Factor de curvatura del arco
            
            arc = rg.Arc(pt_a, mid, pt_b)
            arc_tree.Add(rg.ArcCurve(arc), path)
            
        # Contamos el intento independientemente de si encontró pareja o no 
        # para respetar el ratio sobre la lista original
        processed_count += 1

# Salidas
a, b, c, d = p_base_tree, l_tree, p_top_tree, arc_tree
# ---------- end python_3_script_3 ----------
line = Line(python_3_script_3.b)
point_2 = Point(python_3_script_3.a)
curve_8 = Curve(python_3_script_3.d)
point_3 = Point(python_3_script_3.c)
